# Grasshopper definition Write Results Hackathon.gh (Grasshopper 1.0.7)
# plug-ins: Pufferfish, PollinationGH

# DOWNLOAD AND LOAD DATA FROM THE CLOUD
panel = Panel("adaptis/tech")
panel_2 = Panel("Failed")
list_jobs = ListJobs(_project=panel, NumberOfJobs=10)  # -> Names, Descriptions, Recipes, Jobs
panel_3 = Panel(list_jobs.Names)
number_slider = Slider(1, range=0..4)

# ---- group: iterate through runs
number_slider_2 = Slider(40, range=0..40)

# ----
item = ListItem(List=list_jobs.Names, Index=number_slider, Wrap=True)
item_2 = ListItem(List=list_jobs.Jobs, Index=number_slider, Wrap=True)
item_3 = ListItem(List=list_jobs.Descriptions, Index=number_slider, Wrap=True)
panel_4 = Panel(item_3)
panel_5 = Panel(item)
check_job_status = CheckJobStatus(_job=item_2, Index_=number_slider_2, getBothInputOutputAssets=False, liveUpdateStatus=True)  # -> Status, Run
check_run_results = CheckRunResults(
    _run=check_job_status.Run,
    recipeSource="https://api.pollination.cloud/registries/ladybug-tools/recipe/custom-energy-sim/0.3.12")  # -> Err, Html, Idf, Sql, Zsz
panel_6 = Panel("C:\AdaptisTech\pollination")
# POSTPROCESSING
check_run_inputs = CheckRunInputs(
    _run=check_job_status.Run,
    recipeSource="https://api.pollination.cloud/registries/ladybug-tools/recipe/custom-energy-sim/0.3.12")  # -> Ddy, Epw, Model, SimPar, User_input_1
load_assets = LoadAssets(Folder_=panel_6, Sql=check_run_results.Sql, liveUpdateStatus=False, postprocessWithHandler=True, useCachedAssets=True)  # -> Logs, Sql, Value_2
load_assets_2 = LoadAssets(Folder_=panel_6, Zsz=check_run_results.Zsz, liveUpdateStatus=False, postprocessWithHandler=True, useCachedAssets=True)  # -> Logs, Zsz, Value_2
readzsz = HBReadZoneSizing(zsz=load_assets_2.Zsz)  # -> cooling_load, heating_load; plug-in component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
xdata = LBDeconstructData(data=readzsz.cooling_load)  # -> header, values; plug-in component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
xdata_2 = LBDeconstructData(data=readzsz.heating_load)  # -> header, values; plug-in component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
ma = MassAddition(Input=xdata.values)  # -> flatten(Result), PartialResults
ma_2 = MassAddition(Input=xdata_2.values)  # -> flatten(Result), PartialResults
python = GhPythonScript(x=ma.Result)  # -> out, a; inputs x: list
# ---------- python: Python ----------
__author__ = "cameron lawrence"
__version__ = "2022.09.17"

import rhinoscriptsyntax as rs

print(max(x))
# ---------- end python ----------
python_2 = GhPythonScript(x=ma_2.Result)  # -> out, a; inputs x: list; same code as python

customresult = HBReadCustomResult(sql=load_assets.Sql, output_names="Zone Mean Air Temperature")  # -> results; plug-in component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
xdata_3 = LBDeconstructData(data=customresult)  # -> simplify(header), simplify(values); plug-in component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
larger = LargerThan(FirstNumber=xdata_3.values, SecondNumber="29.31")  # -> LargerThan, OrEqualTo
num = Number(larger.LargerThan)
ma_3 = MassAddition(Input=num)  # -> flatten(Result), PartialResults

panel_7 = Panel(python_2.out)
panel_8 = Panel(python.out)
python_3 = GhPythonScript(x=ma_3.Result)  # -> out, a; inputs x: list
# ---------- python_3: Python ----------
__author__ = "cameron lawrence"
__version__ = "2022.09.17"

import rhinoscriptsyntax as rs
a=x[2:]
print(a)
# ---------- end python_3 ----------
pollinationuserinput = Data(check_run_inputs.User_input_1)
panel_9 = Panel(pollinationuserinput)
hours_above_drybulb = Data(python_3.a)
peak_cool = Data(panel_8)
peak_heating = Data(panel_7)
split = TextSplit(Text=pollinationuserinput, Separators="&")
split_2 = TextSplit(Text=split, Separators="::")
panel_10 = Panel("""Peak_Cooling_Load
Peak_Heating_Load
Hours_above_acceptability
1
2
3
4
5
6
7
8
9
10
11""")
item_4 = ListItem(List=split_2, Index=0, Wrap=True)  # -> flatten(Item), Item1, flatten(Item2)
entwine = Entwine(Branch00=panel_10, FlattenInputs=True)  # -> flatten(Result)
entwine_2 = Entwine(Branch00=item_4.Item2, Branch01=peak_cool, Branch02=peak_heating, Branch03=hours_above_drybulb, FlattenInputs=True)  # -> flatten(Result)
concat = Concatenate(FragmentA="out:", FragmentB=entwine)
concat_2 = Concatenate(FragmentA="in:", FragmentB=item_4.Item)
entwine_3 = Entwine(Branch00=concat_2, Branch01=concat, FlattenInputs=True)  # -> flatten(Result)
headings = Data(entwine_3)
data = Data(item)
data_2 = Data(entwine_2)

# ---- group: set to true to write to .csv
# WRITE .CSV (DESIGN EXPLORER COMPATIBLE)
writeexcel = BooleanToggle(True)

# ---- group: set to true to ovewrite the file at specified location
overwrite = BooleanToggle(True)

# ----
concat_3 = Concatenate(FragmentA="C:\AdaptisTech\data\", FragmentC=data, FragmentB=".csv")
invbool = InvertBoolean(Boolean=overwrite)  # -> Inverted, Number
python_4 = GhPythonScript(run=writeexcel, path=concat_3, headings=headings, data=data_2, animate=number_slider_2)  # -> out, a; inputs headings: list, data: list, animate: Int32
# ---------- python_4: Python ----------
import rhinoscriptsyntax as rs
import Rhino as rh
from System import Decimal
import Grasshopper as gh
from ghpythonlib import treehelpers as th


if run:
    concData = ""
    if animate == 0:
        for i in range(0, len(headings)):
            el = headings[i]
            if i<len(headings)-1:
                concData += str(el) + ","
            else:
                concData += str(el)
                
            with open(path, 'w') as file_object:
                file_object.write(concData)
    concData = ""
    concData += "\n"
    for i in range(0, len(data)):
        el = float(data[i])
        
        if i<len(data)-1:
            concData += str(el) + ","
        else:
            concData += str(el)
        
            
    print(concData)
    print('data-----',data)
    with open(path, 'a') as file_object:
        file_object.write(concData)
# ---------- end python_4 ----------
rec = DataRecorder(python_4.out, DataLimit=-10, RecordData=True)
readzsz_2 = HBReadZoneSizing()  # -> cooling_load, heating_load; plug-in component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
readzsz_3 = HBReadZoneSizing()  # -> cooling_load, heating_load; plug-in component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
readzsz_4 = HBReadZoneSizing()  # -> cooling_load, heating_load; plug-in component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
xdata_4 = LBDeconstructData(data=readzsz_2.cooling_load)  # -> header, values; plug-in component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
xdata_5 = LBDeconstructData(data=readzsz_3.cooling_load)  # -> header, values; plug-in component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
ma_4 = MassAddition(Input=xdata_4.values)  # -> flatten(Result), PartialResults
ma_5 = MassAddition(Input=xdata_5.values)  # -> flatten(Result), PartialResults
python_5 = GhPythonScript(x=ma_4.Result)  # -> out, a; inputs x: list; same code as python
python_6 = GhPythonScript(x=ma_5.Result)  # -> out, a; inputs x: list; same code as python
xdata_6 = LBDeconstructData(data=readzsz_4.cooling_load)  # -> header, values; plug-in component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
panel_11 = Panel(python_5.out)
panel_12 = Panel(python_6.out)
ma_6 = MassAddition(Input=xdata_6.values)  # -> flatten(Result), PartialResults
python_7 = GhPythonScript(x=ma_6.Result)  # -> out, a; inputs x: list; same code as python
panel_13 = Panel(python_7.out)
readzsz_5 = HBReadZoneSizing()  # -> cooling_load, heating_load; plug-in component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
xdata_7 = LBDeconstructData(data=readzsz_5.cooling_load)  # -> header, values; plug-in component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
ma_7 = MassAddition(Input=xdata_7.values)  # -> flatten(Result), PartialResults
python_8 = GhPythonScript(x=ma_7.Result)  # -> out, a; inputs x: list; same code as python
panel_14 = Panel(python_8.out)
