# Grasshopper definition hackathon_V4.gh (Grasshopper 1.0.7)
# plug-ins: PollinationGH, Human

number_slider = Slider(500, range=0..500)
floor = Panel("10")
python = GhPythonScript(x="C:\Users\cameron lawrence\Documents\hack_test_3.csv", y=number_slider)  # -> WWR_N, WWR_E, WWR_S, WWR_W, Louver_Depth, Horiz_Overhang, Wall_R, Roof_R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; inputs y: Int32
# ---------- python: Python ----------
ind=[]
WWR_N=[]
WWR_E=[]
WWR_S=[]
WWR_W=[]
Louver_Depth=[]
Horiz_Overhang=[]
Wall_R=[]
Roof_R =[]
Glazing_U =[]
Operable_Percent=[]
Width=[]
Length=[]
SHGC=[]
rows=[]


with open(x) as inf:
    next(inf)
    
    for row in inf:
        rows.append(row)
    print(rows[0])
    line=rows[y]
    ind=(line.split(',')[0])
    WWR_N=(line.split(',')[1])
    WWR_E=(line.split(',')[2])
    WWR_S=(line.split(',')[3])
    WWR_W=(line.split(',')[4])
    Louver_Depth=(line.split(',')[5])
    Horiz_Overhang=(line.split(',')[6])
    Wall_R=(line.split(',')[7])
    Roof_R=(line.split(',')[8])
    Glazing_U=(line.split(',')[9])
    Operable_Percent=(line.split(',')[10])
    Scale=(line.split(',')[11])
    Length=(line.split(',')[12])
    SHGC=(line.split(',')[13])
    Infil=(line.split(',')[14])
# ---------- end python ----------
division = Division(A=floor, B=" 5.678")
infiltration = Data(python.Infil)
wwr_n = Data(python.WWR_N)
wwr_e = Data(python.WWR_E)
wwr_s = Data(python.WWR_S)
wwr_w = Data(python.WWR_W)
louver_depth = Data(python.Louver_Depth)
overhang_depth = Data(python.Horiz_Overhang)
wall_assembly = Data(python.Wall_R)
roof_r_value = Data(python.Roof_R)
glazing_u_factor = Data(python.Glazing_U)
fraction_operable = Data(python.Operable_Percent)
scale = Data(python.Scale)
shgc = Data(python.SHGC)
relationship = Panel("5.68")
division_2 = Division(A=roof_r_value, B=relationship)
division_3 = Division(A=wall_assembly, B=relationship)
entwine = Entwine(Branch00=wwr_n, Branch01=wwr_e, Branch02=wwr_s, Branch03=wwr_w, FlattenInputs=True)
multiplication = Multiplication(A=glazing_u_factor, B=relationship)
wall_r_value = Data(division_3)
dhw_load_l_h_m2 = Panel("""0.345
0""")

# ----
# LOADS AND SCHEDULES
panel = Panel("""Suite
Corridor""")
vent_person = Panel("""2.5
0""")
division_4 = Division(A=vent_person, B="1000")
vent_area = Panel("""0.3
0.67""")
division_5 = Division(A=vent_area, B="1000")
panel_2 = Panel("""2019::Courthouse::Break Room
2019::Courthouse::Cell
2019::Courthouse::Conference
2019::Courthouse::Corridor
2019::Courthouse::Courtroom
2019::Courthouse::Courtroom Waiting
2019::Courthouse::Elevator Lobby
2019::Courthouse::Elevator Shaft
2019::Courthouse::Entrance Lobby
2019::Courthouse::Judges Chamber
2019::Courthouse::Jury Assembly
2019::Courthouse::Jury Deliberation
2019::Courthouse::Library
2019::Courthouse::Office
2019::Courthouse::Parking
2019::Courthouse::Plenum
2019::Courthouse::Restrooms
2019::Courthouse::Security Screening
2019::Courthouse::Service Shaft
2019::Courthouse::Stairs
2019::Courthouse::Storage
2019::Courthouse::Utility
2019::FullServiceRestaurant::Attic
2019::FullServiceRestaurant::Dining
2019::FullServiceRestaurant::Kitchen
2019::HighriseApartment::Apartment
2019::HighriseApartment::Corridor
2019::HighriseApartment::Office
2019::Hospital::Basement
2019::Hospital::Corridor
2019::Hospital::Dining
2019::Hospital::ER_Exam
2019::Hospital::ER_NurseStn
2019::Hospital::ER_Trauma
2019::Hospital::ER_Triage
2019::Hospital::HospitalOffice
2019::Hospital::ICU_NurseStn
2019::Hospital::ICU_Open
2019::Hospital::ICU_PatRm
2019::Hospital::Kitchen
2019::Hospital::Lab
2019::Hospital::Lobby
2019::Hospital::NurseStn
2019::Hospital::OR
2019::Hospital::Office
2019::Hospital::PatCorridor
2019::Hospital::PatRoom
2019::Hospital::PhysTherapy
2019::Hospital::Radiology
2019::Laboratory::Equipment corridor
2019::Laboratory::Lab with fume hood
2019::Laboratory::Office
2019::Laboratory::Open lab
2019::LargeDataCenterHighITE::StandaloneDataCenter
2019::LargeDataCenterLowITE::StandaloneDataCenter
2019::LargeHotel::Banquet
2019::LargeHotel::Basement
2019::LargeHotel::Cafe
2019::LargeHotel::Corridor
2019::LargeHotel::GuestRoom
2019::LargeHotel::GuestRoom2
2019::LargeHotel::GuestRoom3
2019::LargeHotel::GuestRoom4
2019::LargeHotel::GuestRoom5
2019::LargeHotel::GuestRoom6
2019::LargeHotel::GuestRoom7
2019::LargeHotel::GuestRoom8
2019::LargeHotel::Kitchen
2019::LargeHotel::Laundry
2019::LargeHotel::Lobby
2019::LargeHotel::Mechanical
2019::LargeHotel::Retail
2019::LargeHotel::Storage
2019::LargeOffice::Attic
2019::LargeOffice::BreakRoom
2019::LargeOffice::Classroom
2019::LargeOffice::ClosedOffice
2019::LargeOffice::Conference
2019::LargeOffice::Corridor
2019::LargeOffice::Dining
2019::LargeOffice::Elec/MechRoom
2019::LargeOffice::Elevator Lobby
2019::LargeOffice::Elevator Machine Room
2019::LargeOffice::Elevator Shaft
2019::LargeOffice::IT_Room
2019::LargeOffice::Lobby
2019::LargeOffice::Main Electrical
2019::LargeOffice::Main Mechanical
2019::LargeOffice::OfficeLarge Data Center
2019::LargeOffice::OfficeLarge Main Data Center
2019::LargeOffice::OpenOffice
2019::LargeOffice::PrintRoom
2019::LargeOffice::Restroom
2019::LargeOffice::Stair
2019::LargeOffice::Storage
2019::LargeOffice::Vending
2019::MediumOffice::Breakroom
2019::MediumOffice::Classroom
2019::MediumOffice::ClosedOffice
2019::MediumOffice::Conference
2019::MediumOffice::Corridor
2019::MediumOffice::Dining
2019::MediumOffice::Elec/MechRoom
2019::MediumOffice::Lobby
2019::MediumOffice::OpenOffice
2019::MediumOffice::Restroom
2019::MediumOffice::Stair
2019::MediumOffice::Storage
2019::MidriseApartment::Apartment
2019::MidriseApartment::Corridor
2019::MidriseApartment::Office
2019::Outpatient::Anesthesia
2019::Outpatient::BioHazard
2019::Outpatient::Cafe
2019::Outpatient::CleanWork
2019::Outpatient::Conference
2019::Outpatient::DressingRoom
2019::Outpatient::Elec/MechRoom
2019::Outpatient::ElevatorPumpRoom
2019::Outpatient::Exam
2019::Outpatient::Hall
2019::Outpatient::IT_Room
2019::Outpatient::Janitor
2019::Outpatient::Lobby
2019::Outpatient::LockerRoom
2019::Outpatient::Lounge
2019::Outpatient::MRI
2019::Outpatient::MRI_Control
2019::Outpatient::MedGas
2019::Outpatient::NurseStation
2019::Outpatient::OR
2019::Outpatient::Office
2019::Outpatient::PACU
2019::Outpatient::PhysicalTherapy
2019::Outpatient::PreOp
2019::Outpatient::ProcedureRoom
2019::Outpatient::Reception
2019::Outpatient::Soil Work
2019::Outpatient::Stair
2019::Outpatient::Toilet
2019::Outpatient::Undeveloped
2019::Outpatient::Xray
2019::PrimarySchool::Cafeteria
2019::PrimarySchool::Classroom
2019::PrimarySchool::ComputerRoom
2019::PrimarySchool::Corridor
2019::PrimarySchool::Gym
2019::PrimarySchool::Kitchen
2019::PrimarySchool::Library
2019::PrimarySchool::Lobby
2019::PrimarySchool::Mechanical
2019::PrimarySchool::Office
2019::PrimarySchool::Restroom
2019::QuickServiceRestaurant::Attic
2019::QuickServiceRestaurant::Dining
2019::QuickServiceRestaurant::Kitchen
2019::Retail::Back_Space
2019::Retail::Core_Retail
2019::Retail::Entry
2019::Retail::Front_Retail
2019::Retail::Point_of_Sale
2019::Retail::Retail
2019::SecondarySchool::Auditorium
2019::SecondarySchool::Cafeteria
2019::SecondarySchool::Classroom
2019::SecondarySchool::ComputerRoom
2019::SecondarySchool::Corridor
2019::SecondarySchool::Gym
2019::SecondarySchool::Kitchen
2019::SecondarySchool::Library
2019::SecondarySchool::Lobby
2019::SecondarySchool::Mechanical
2019::SecondarySchool::Office
2019::SecondarySchool::Restroom
2019::SmallDataCenterHighITE::ComputerRoom
2019::SmallDataCenterLowITE::ComputerRoom
2019::SmallHotel::Corridor
2019::SmallHotel::Elec/MechRoom
2019::SmallHotel::ElevatorCore
2019::SmallHotel::Exercise
2019::SmallHotel::GuestLounge
2019::SmallHotel::GuestRoom
2019::SmallHotel::GuestRoomOcc
2019::SmallHotel::GuestRoomVac
2019::SmallHotel::Laundry
2019::SmallHotel::Mechanical
2019::SmallHotel::Meeting
2019::SmallHotel::Office
2019::SmallHotel::PublicRestroom
2019::SmallHotel::StaffLounge
2019::SmallHotel::Stair
2019::SmallHotel::Storage
2019::SmallOffice::Breakroom
2019::SmallOffice::Classroom
2019::SmallOffice::ClosedOffice
2019::SmallOffice::Conference
2019::SmallOffice::Corridor
2019::SmallOffice::Dining
2019::SmallOffice::Elec/MechRoom
2019::SmallOffice::Lobby
2019::SmallOffice::OpenOffice
2019::SmallOffice::Restroom
2019::SmallOffice::Stair
2019::SmallOffice::Storage
2019::StripMall::Type 0A
2019::StripMall::Type 0B
2019::StripMall::Type 1
2019::StripMall::Type 2
2019::StripMall::Type 3
2019::SuperMarket::Bakery
2019::SuperMarket::Corridor
2019::SuperMarket::Deli
2019::SuperMarket::Dining
2019::SuperMarket::DryStorage
2019::SuperMarket::Elec/MechRoom
2019::SuperMarket::Meeting
2019::SuperMarket::Office
2019::SuperMarket::Produce
2019::SuperMarket::Restroom
2019::SuperMarket::Sales
2019::SuperMarket::Vestibule
2019::Warehouse::Bulk
2019::Warehouse::Fine
2019::Warehouse::Office""")
occupancy = Panel("""0.04
0.01""")
lpd = Panel("""5
7.1""")
equipment_power = Panel("""5
0""")
necb_schedule = Panel("""G
G""")
base_program = Panel("""2019::MidriseApartment::Apartment
2019::MidriseApartment::Corridor""")
entwine_2 = Entwine(
    Branch00=panel,
    Branch01=division_4,
    Branch02=division_5,
    Branch03=occupancy,
    Branch04=lpd,
    Branch05=equipment_power,
    Branch06=necb_schedule,
    Branch07=base_program,
    Branch08=dhw_load_l_h_m2,
    FlattenInputs=True)

list_item = ListItem(List=entwine_2, Index=0, Wrap=True)  # -> Item, Item1, Item2, Item3, Item4, Item5, Item6, Item7, Item8

dup = DuplicateData(Data="60", Number="24", Order=True)
dup_2 = DuplicateData(Data="24", Number="24", Order=True)
weeklyschedule = HBWeeklySchedule(sun=dup, mon=dup, tue=dup, wed=dup, thu=dup, fri=dup, sat=dup, holiday=dup, summer_des=dup_2, type_limit="Temperature")  # -> report, schedule, idf_year, idf_week, idf_days; plug-in component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

# ----
# NOT USED
panel_3 = Panel("0")
dup_3 = DuplicateData(Data="1", Number="24", Order=True)
dup_4 = DuplicateData(Data=panel_3, Number="24", Order=True)
weeklyschedule_2 = HBWeeklySchedule(
    sun=dup_4,
    mon=dup_4,
    tue=dup_4,
    wed=dup_4,
    thu=dup_4,
    fri=dup_4,
    sat=dup_4,
    holiday=dup_4,
    summer_des=dup_3,
    type_limit="On-Off")  # -> report, schedule, idf_year, idf_week, idf_days; plug-in component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
layer_table = LayerTable(Update=Button(), AutoUpdate=False)  # -> Layers, FullLayerPaths, LayerColors, Linetypes, MaterialNames, Visible, PrintWidth, PrintColor
cull_i = CullIndex(List=layer_table.Layers, Wrap=True)  # disabled
layer = Panel(layer_table.Layers)
boolean_toggle = BooleanToggle(True)
# Preview Geometry
fraction_operable_2 = Data(fraction_operable)
overhang_depth_2 = Data(overhang_depth)
louver_depth_2 = Data(louver_depth)
panel_4 = Panel(louver_depth_2)
number_slider_2 = Slider(2, range=0..10)
# Windows by Ratio
toggle = BooleanToggle(True)
number_slider_3 = Slider(0.8, range=0..0.8)
toggle_2 = BooleanToggle(True)
entwine_3 = Entwine(Branch00="0", Branch01=louver_depth_2, Branch02="0", Branch03=louver_depth_2, FlattenInputs=True)  # -> flatten(Result)
entwine_4 = Entwine(Branch00="0", Branch01="0", Branch02=overhang_depth_2, Branch03="0", FlattenInputs=True)  # -> flatten(Result)
ventcontrol = HBVentilationControl(min_in_temp="23", max_out_temp="24")  # -> vent_cntrl; plug-in component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
number_slider_4 = Slider(2, range=0..10)
number_slider_5 = Slider(2, range=0..10)
number_slider_6 = Slider(0.1, range=0..1)
number_slider_7 = Slider(0.1, range=0..1)
# Assign EP constructions
panel_5 = Panel("Ext Wall Mass")
opaquemat = HBOpaqueMaterial(
    name=panel_5,
    thickness=Slider(0.05, range=0..0.1),
    conductivity=number_slider_5,
    density=Slider(2000, range=0..10000),
    spec_heat=Slider(840, range=0..1000))  # -> mat; plug-in component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
opaquemat_2 = HBOpaqueMaterial(
    name="Concrete Slab",
    thickness=number_slider_6,
    conductivity=number_slider_4,
    density=Slider(2000, range=0..10000),
    spec_heat=Slider(840, range=0..1000))  # -> mat; plug-in component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
opaquemat_3 = HBOpaqueMaterial(
    name="Int Wall Mass",
    thickness=Slider(0.05, range=0..0.1),
    conductivity=Slider(2, range=0..10),
    density=Slider(2000, range=0..10000),
    spec_heat=Slider(840, range=0..1000))  # -> mat; plug-in component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
wall_r_value_2 = Data(wall_r_value)
roof_r_value_2 = Data(division_2)
floor_r_value = Data(division)
python_2 = GhPythonScript(x=number_slider_7, y=number_slider_5, z=roof_r_value_2)  # -> out, a
# ---------- python_2: Python ----------
__author__ = "cameron lawrence"
__version__ = "2022.09.10"

import rhinoscriptsyntax as rs

r_value_concrete=x/y
r_value_insulation=z-r_value_concrete
print(r_value_insulation)
# ---------- end python_2 ----------
python_3 = GhPythonScript(x=number_slider_7, y=number_slider_5, z=wall_r_value_2)  # -> out, a; same code as python_2
shgc_2 = Data(shgc)
glazing_u_factor_2 = Data(multiplication)
hvac_type = Relay()
panel_6 = Panel("""Suite
Corridor""")

# ----
# WEATHER
panel_7 = Panel("https://climate.onebuilding.org/WMO_Region_4_North_and_Central_America/USA_United_States_of_America/GA_Georgia/USA_GA_Atlanta-Hartsfield-Jackson.Intl.AP.722190_TMY3.zip")
boolean_toggle_2 = BooleanToggle(True)
downloadepw = LBDownloadWeather(weather_URL=panel_7)  # -> out, epw_file, stat_file, ddy_file; plug-in component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
importddy = LBImportDDY(ddy_file=downloadepw.ddy_file)  # -> location, design_days; plug-in component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
epw = Data(downloadepw.epw_file)

number_slider_8 = Slider(1, range=0..1)
decnstrdesignday = LBDeconstructDesignDay(design_day=importddy.design_days)  # -> name, day_type, location, date, dry_bulb_max, dry_bulb_range, humidity_type, humidity_value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; plug-in component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

roomattr = HBRoomAttributes({"Display Name": "display_name", "Simulation Name (Identifier)": "identifier", "Multiplier": "multiplier", "Story": "story", "Volume": "volume", "Gross Floor Area": "floor_area", "Exposed Area": "exposed_area", "Exterior Wall Area": "exterior_wall_area", "Exterior Aperture Area": "exterior_aperture_area", "Average Floor Elevation": "average_floor_height"}, selected="Display Name")
roomenergyattr = HBRoomEnergyAttributes({"Program": "properties.energy.program_type.display_name", "Construction Set": "properties.energy.construction_set.display_name", "Is Conditioned": "properties.energy.is_conditioned", "People per Area [ppl/m2]": "properties.energy.people.people_per_area", "Area per Person [m2/ppl]": "properties.energy.people.area_per_person", "Lighting per Area [W/m2]": "properties.energy.lighting.watts_per_area", "Electric Equipment per Area [W/m2]": "properties.energy.electric_equipment.watts_per_area", "Gas Equipment per Area [W/m2]": "properties.energy.gas_equipment.watts_per_area", "Hot Water per Area [L/h-m2]": "properties.energy.service_hot_water.flow_per_area", "Infiltration per Exterior Area [m3/s-m2]": "properties.energy.infiltration.flow_per_exterior_area"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}, selected="Program")
faceenergyattr = HBFaceEnergyAttributes({"Construction": "properties.energy.construction.display_name", "Materials": "properties.energy.construction.layers", "R-Value": "properties.energy.construction.r_value", "U-Value": "properties.energy.construction.u_value", "U-Factor": "properties.energy.construction.u_factor", "SHGC [Unshaded]": "properties.energy.construction.shgc", "Solar Transmitance [Unshaded]": "properties.energy.construction.solar_transmittance", "Visible Transmitance [Unshaded]": "properties.energy.construction.visible_transmittance", "Solar Reflectance [Outside]": "properties.energy.construction.outside_solar_reflectance", "Solar Reflectance [Inside]": "properties.energy.construction.inside_solar_reflectance", "Fraction Area Operable": "properties.energy.vent_opening.fraction_area_operable", "Fraction Height Operable": "properties.energy.vent_opening.fraction_height_operable", "Discharge Coefficient": "properties.energy.vent_opening.discharge_coefficient"}, selected="Construction")
faceattr = HBFaceAttributes({"Display Name": "display_name", "Simulation Name (Identifier)": "identifier", "Boundary Condition": "boundary_condition", "Has Parent": "has_parent", "Parent": "parent", "Area": "area", "Perimeter": "perimeter", "Face Type": "type", "Aperture Is Operable": "is_operable", "Door Is Glass": "is_glass"}, selected="Boundary Condition")
vizall = HBVisualizeAll()  # -> geo; plug-in component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
vizwiref = HBVisualizeWireframe()  # -> geo; plug-in component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
custom_preview = CustomPreview(Geometry=vizall, Material=ColourSwatch(SwatchColor=RGBA(153, 153, 153, 124)))
custom_preview_2 = CustomPreview(Geometry=vizwiref, Material=ColourSwatch(SwatchColor=RGB(0, 0, 0)))
labelrooms = HBLabelRooms(attribute=roomenergyattr)  # -> label_text, base_pts, labels, wire_frame; plug-in component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
lablefaces = HBLabelFaces(attribute=faceattr, sub_faces=Toggle(False), txt_height="0.5")  # -> out, label_text, base_pts, labels, wire_frame; plug-in component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

ddy = Data(downloadepw.ddy_file)
panel_8 = Panel(decnstrdesignday.dry_bulb_max)

# ---- group: SIMULATION CONTROL PARAMETERS / Report Frequency Controls
panel_9 = Panel("sensible")
panel_10 = Panel("annual")
panel_11 = Panel("timestep")

# ----
# Measures
update_path = Panel("C:\Users\cameron lawrence\Documents\Adaptis\Patryk\FansMultiplier")
sizingpar = HBSizingParameter(ddy_file=ddy, filter_ddays=Toggle(True), heating_fac=Slider(1.5, range=0..10))  # -> sizing; plug-in component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
panel_12 = Panel("""Zone Cooling Setpoint Not Met While Occupied Time
Zone Thermostat Cooling Setpoint Temperature
Zone Mean Air Temperature""")
fans_multiplier = FansMultiplier(measure_path=update_path, pressure_rise_multiplier=".5")  # -> report, measure; plug-in component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
analysisperiod = LBAnalysisPeriod(start_month="7", start_day="21", start_hour="0", end_month="7", end_day="27", end_hour="23", timestep="4")  # -> period, hoys, dates; plug-in component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

# ---- group: SIMULATION CONTROL PARAMETERS
boolean_toggle_3 = BooleanToggle(False)
boolean_toggle_4 = BooleanToggle(False)
simoutput = HBSimulationOutput(zone_energy_use=boolean_toggle_3, hvac_energy_use=boolean_toggle_3)  # -> report, sim_output; plug-in component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
simcontrol = HBSimulationControl(
    do_zone_sizing=Toggle(True),
    do_system_sizing=boolean_toggle_4,
    do_plant_sizing=boolean_toggle_4,
    for_sizing_period=boolean_toggle_4,
    for_run_period=Toggle(True))  # -> sim_control; plug-in component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
shadowcalc = HBShadowCalculation(solar_dist="4")  # -> shadow_calc; plug-in component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
natural_gas_energy = Data(["Boiler NaturalGas Energy", "Water Heater NaturalGas Energy", "Water Heater Off Cycle Parasitic NaturalGas Energy", "Water Heater On Cycle Parasitic NaturalGas Energy", "Air System NaturalGas Energy", "Air System Heating Coil NaturalGas Energy", "Air System Humidifier NaturalGas Energy"])
custom_outputs = Data(["Plant Supply Side Unmet Demand Rate", "Zone Heating Setpoint Not Met Time", "Zone Heating Setpoint Not Met While Occupied Time", "Zone Cooling Setpoint Not Met Time", "Zone Cooling Setpoint Not Met While Occupied Time"])
customoutput = HBCustomSimulationOutput(base_sim_output=simoutput.sim_output, output_names=flatten(panel_12))  # -> report, sim_output; plug-in component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
simpar = HBSimulationParameter(
    output=customoutput.sim_output,
    run_period=analysisperiod.period,
    timestep="4",
    sim_control=simcontrol,
    shadow_calc=shadowcalc,
    sizing=sizingpar)  # -> sim_par; plug-in component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

# ----
wwr_e_2 = Data(python.WWR_E)
wwr_s_2 = Data(python.WWR_S)
wall_assembly_2 = Data(python.Wall_R)
roof_r_value_3 = Data(python.Roof_R)
wwr_n_2 = Data(python.WWR_N)
wwr_w_2 = Data(python.WWR_W)
louver_depth_3 = Data(python.Louver_Depth)
overhang_depth_3 = Data(python.Horiz_Overhang)
glazing_u_factor_3 = Data(python.Glazing_U)
fraction_operable_3 = Data(python.Operable_Percent)
scale_2 = Data(python.Scale)
infiltration_2 = Data(infiltration)
entwine_5 = Entwine(
    Branch00=wwr_n_2,
    Branch01=wwr_e_2,
    Branch02=wwr_s_2,
    Branch03=wwr_w_2,
    Branch04=louver_depth_3,
    Branch05=overhang_depth_3,
    Branch06=wall_assembly_2,
    Branch07=roof_r_value_3,
    Branch08=glazing_u_factor_3,
    Branch09=fraction_operable_3,
    Branch010=scale_2,
    Branch011=infiltration_2,
    FlattenInputs=True)  # -> flatten(Result)
panel_13 = Panel("""WWR_N
WWR_E
WWR_S
WWR_W
Louver_Depth
Horiz_Overhang
Wall_R
Roof_R
Glazing_U
Operable_Percent
Scale
SHGC
Infil""")
panel_14 = Panel(entwine_5)
iterator = Data(number_slider)
data = Data(panel_13)
data_2 = Data(entwine_5)
concatenate = Concatenate(FragmentA="option", FragmentC="::", FragmentB=iterator)
concatenate_2 = Concatenate(FragmentA=data, FragmentC="::", FragmentB=data_2)
entwine_6 = Entwine(Branch00=concatenate, Branch01=concatenate_2, FlattenInputs=True)  # -> flatten(Result)
text_join = TextJoin(Text=entwine_6, Join="&")
user_inputs = UserInputs(User_input_1=text_join)
ddy_2 = Data(ddy)
epw_2 = Data(epw)
simpar_2 = Data(simpar)
# Record Runs
toggle_3 = BooleanToggle(True)
login = Login(_login_=toggle_3)

# ---- group: iterate through runs
number_slider_9 = Slider(1, range=0..5)

# ----
# CREATE PROGRAMS
list_item_2 = ListItem(List=flatten(list_item.Item), Index=0, Wrap=True)  # -> Item, Item1, Item2, Item3, Item4, Item5, Item6, Item7, Item8
infiltrationrate = Data(infiltration)

# ---- group: This is important for correct Heating
ventilation = HBVentilation(flow_per_person=list_item_2.Item1, flow_per_area=list_item_2.Item2)  # -> vent; plug-in component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

# ----
programtype = HBProgramType(name=list_item_2.Item, base_program=list_item_2.Item7, ventilation=ventilation)  # -> program; plug-in component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
applyloadvals = HBApplyLoadValues(room_or_program=flatten(programtype), infilt_per_exterior=infiltrationrate)  # -> report, mod_obj; plug-in component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
applyroomsch = HBApplyRoomSchedules(
    room_or_program=flatten(applyloadvals.mod_obj),
    ventilation_sch=weeklyschedule_2.schedule,
    cooling_setpt_sch=weeklyschedule.schedule)  # -> report, mod_obj; plug-in component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

deconstrprogram = HBDeconstructProgramType(program=applyroomsch.mod_obj)  # -> people, lighting, electric_equip, gas_equip, hot_water, infiltration, ventilation, setpoint; plug-in component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
panel_15 = Panel(deconstrprogram.lighting)
panel_16 = Panel(list_item_2.Item)
panel_17 = Panel(panel_16)
tmatch = MatchText(Text=layer, RegEx=graft(panel_17), Case=True)
cull = CullPattern(List=layer, CullPattern=tmatch)  # -> flatten(List)
panel_18 = Panel(cull)
dynamic_geometry_pipeline = DynamicGeometryPipeline(
    LayerFilter=cull,
    TypeFilter="all",
    NameFilter="*",
    GroupByLayer=False,
    GroupByType=False,
    IncludeHidden=True,
    IncludeLocked=True,
    enableFullPath=False,
    listenToAttributes=True)
roomsolid = HBRoomFromSolid(geo=flatten(dynamic_geometry_pipeline), name=panel_16, program=applyroomsch.mod_obj, conditioned=True)  # -> report, rooms; plug-in component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

list_item_3 = ListItem(List=flatten(list_item.Item1), Index=0, Wrap=True)  # -> Item, Item1, Item2, Item3, Item4, Item5, Item6, Item7, Item8
# Create Shading and add Surrounding Buildings
panel_19 = Panel("NECB-")
concatenate_3 = Concatenate(FragmentA=panel_19, FragmentB=list_item_3.Item6)
infiltrationrate_2 = Data(python.Infil)

# ---- group: This is important for correct Heating
ventilation_2 = HBVentilation(flow_per_person=list_item_3.Item1, flow_per_area=list_item_3.Item2)  # -> vent; plug-in component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

# ----
programtype_2 = HBProgramType(name=list_item_3.Item, base_program=list_item_3.Item7, ventilation=ventilation_2)  # -> program; plug-in component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
applyloadvals_2 = HBApplyLoadValues(room_or_program=flatten(programtype_2), infilt_per_exterior=infiltrationrate_2)  # -> report, mod_obj; plug-in component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
applyroomsch_2 = HBApplyRoomSchedules(
    room_or_program=flatten(applyloadvals_2.mod_obj),
    ventilation_sch=weeklyschedule_2.schedule,
    cooling_setpt_sch=weeklyschedule.schedule)  # -> report, mod_obj; plug-in component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

panel_20 = Panel(list_item_3.Item)
filter = Panel(panel_20)
tmatch_2 = MatchText(Text=layer, RegEx=graft(filter), Case=True)
cull_2 = CullPattern(List=layer, CullPattern=tmatch_2)  # -> flatten(List)
dynamic_geometry_pipeline_2 = DynamicGeometryPipeline(
    LayerFilter=cull_2,
    TypeFilter="all",
    NameFilter="*",
    GroupByLayer=False,
    GroupByType=False,
    IncludeHidden=True,
    IncludeLocked=True,
    enableFullPath=False,
    listenToAttributes=True)
panel_21 = Panel(dynamic_geometry_pipeline_2)
roomsolid_2 = HBRoomFromSolid(geo=flatten(dynamic_geometry_pipeline_2), name=panel_20, program=applyroomsch_2.mod_obj, conditioned=True)  # -> report, rooms; plug-in component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
entwine_7 = Entwine(Branch00=roomsolid.rooms, Branch01=roomsolid_2.rooms, FlattenInputs=True)  # -> flatten(Result)
clean_tree = CleanTree(RemoveNulls=True, RemoveInvalid=True, RemoveEmpty=False, Tree=entwine_7)
solveadj = HBSolveAdjacency(rooms=flatten(clean_tree), overwrite=boolean_toggle, run=boolean_toggle)  # -> report, graft(adj_rooms); plug-in component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
aperturesbyratio = HBAperturesByRatio(
    hb_objs=flatten(solveadj.adj_rooms),
    ratio=flatten(entwine),
    subdivide=toggle,
    win_height=Slider(3.6, range=0..10),
    horiz_separ=Slider(6, range=0..100),
    operable=Toggle(True))  # -> report, hb_objs; plug-in component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
louvershades = HBLouverShades(
    hb_objs=flatten(aperturesbyratio.hb_objs),
    depth=entwine_3,
    shade_count=Slider(1, range=0..10),
    vertical=toggle_2,
    flip_start=toggle_2)  # -> report, hb_objs; plug-in component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
louvershades_2 = HBLouverShades(hb_objs=flatten(louvershades.hb_objs), depth=entwine_4, shade_count=Slider(1, range=0..1), vertical=Toggle(False))  # -> report, hb_objs; plug-in component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
windowopen = HBWindowOpening(rooms=flatten(louvershades_2.hb_objs), vent_cntrl=ventcontrol, fract_area_oper=fraction_operable_2)  # -> report, rooms; plug-in component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

data_3 = Data(flatten(aperturesbyratio.hb_objs))
floor_r_value_2 = Data(division)
opaquematnomass = HBOpaqueMaterialNoMass(name="OpaqueMaterial", r_value=python_3.out)  # -> mat; plug-in component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
opaquematnomass_2 = HBOpaqueMaterialNoMass(name="RoofMaterial", r_value=python_2.out)  # -> mat; plug-in component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
opaquematnomass_3 = HBOpaqueMaterialNoMass(name="InteriorWallMaterial", r_value=".5")  # -> mat; plug-in component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
opaquematnomass_4 = HBOpaqueMaterialNoMass(name="Interior Ceiling Material", r_value="1")  # -> mat; plug-in component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
windowmat = HBWindowMaterial(name="WindowMaterial", u_factor=glazing_u_factor_2, shgc=shgc_2, t_vis="0.45")  # -> mat; plug-in component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
windowconstr = HBWindowConstruction(name="WindowConstruction", materials=windowmat)  # -> constr; plug-in component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
subfacesubset = HBSubfaceSubset(window=windowconstr, skylight=windowconstr, operable=windowconstr)  # -> subface_set; plug-in component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

merge = Merge(Data1=opaquematnomass_4, Data2=opaquemat_2, Data3=opaquematnomass_4)  # -> flatten(Result)
python_4 = GhPythonScript(x=number_slider_6, y=number_slider_4, z=floor_r_value_2)  # -> out, a; same code as python_2
merge_2 = Merge(Data1=opaquematnomass, Data2=opaquemat)  # -> flatten(Result)
merge_3 = Merge(Data1=opaquematnomass_2)  # -> flatten(Result)
merge_4 = Merge(Data1=opaquematnomass_3, Data2=opaquemat_3, Data3=opaquematnomass_3)  # -> flatten(Result)

opaquematnomass_5 = HBOpaqueMaterialNoMass(name="ExtFloorMaterial", r_value=python_4.out)  # -> mat; plug-in component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
opaqueconstr = HBOpaqueConstruction(name="Ext Wall Construction", materials=merge_2)  # -> constr; plug-in component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
opaqueconstr_2 = HBOpaqueConstruction(name="Ext Roof Construction", materials=merge_3)  # -> constr; plug-in component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
opaqueconstr_3 = HBOpaqueConstruction(name="Int Wall Construction", materials=merge_4)  # -> constr; plug-in component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
opaqueconstr_4 = HBOpaqueConstruction(name="Int Ceiling Construction", materials=merge)  # -> constr; plug-in component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
interiorsubset = HBInteriorConstructionSubset(interior_wall=opaqueconstr_3, ceiling=opaqueconstr_4, interior_floor=opaqueconstr_4)  # -> interior_set; plug-in component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

merge_5 = Merge(Data1=opaquematnomass_5, Data2=opaquemat_2)  # -> flatten(Result)

opaqueconstr_5 = HBOpaqueConstruction(name="Ext Floor Construction", materials=merge_5)  # -> constr; plug-in component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
exteriorsubset = HBExteriorConstructionSubset(exterior_wall=opaqueconstr, exterior_roof=opaqueconstr_2, exposed_floor=opaqueconstr_5)  # -> exterior_set; plug-in component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

groundsubset = HBGroundConstructionSubset(ground_floor=opaqueconstr_5)  # -> ground_set; plug-in component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

constructionset = HBConstructionSet(exterior_subset=exteriorsubset, ground_subset=groundsubset, interior_subset=interiorsubset, subface_subset=subfacesubset)  # -> constr_set; plug-in component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
applyconstrset = HBApplyConstructionSet(rooms=windowopen.rooms, constr_set=constructionset)  # -> rooms; plug-in component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

tmatch_3 = MatchText(Text=applyconstrset, RegEx=graft(panel_6), Case=True)
# IDEAL AIR
cull_3 = CullPattern(List=applyconstrset, CullPattern=tmatch_3)  # -> flatten(List)

# ----
# Ideal Air
panel_22 = Panel("NoEconomizer")
idealair = HBIdealAir(rooms=flatten(cull_3), economizer=panel_22, sensible_hr="0")  # -> out, rooms; plug-in component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
# SIMULATION SETTINGS
panel_23 = Panel(idealair.rooms)

clock = Clock(SecondHand=True)
# Assemble HB Model
date = Panel("20220811_")
date_2 = Data(date)
data_4 = Data(clock)
panel_24 = Panel(data_4)
text_split = TextSplit(Text=panel_24, Separators=":")
text_join_2 = TextJoin(Text=text_split)

# ---- group: models for pollination need to have unique names if sent in a batch
date_3 = Data(date_2)
iterator_2 = Data(number_slider)
concatenate_4 = Concatenate(FragmentE=date_3, FragmentA="parametric_model", FragmentC=text_join_2, FragmentD="_", FragmentB=iterator_2)

# ----
model = HBModel(rooms=flatten(idealair.rooms), name=concatenate_4)  # -> report, model; plug-in component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

hbmodel = Data(model.model)
scale_3 = HBScale(hb_objs=flatten(hbmodel), factor=scale)  # -> hb_objs; plug-in component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
vizbytype = HBVisualizeByType(hb_objs=scale_3)  # -> walls, interior_walls, roofs, ceilings, exterior_floors, interior_floors, air_walls, apertures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; plug-in component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
model_2 = Data(scale_3)
setup_runs = SetupRuns(
    _ddy=ddy_2,
    _epw=epw_2,
    _model=model_2,
    Sim_par=simpar_2,
    _user_inputs_=user_inputs,
    Owner="ladybug-tools",
    RecipeJsonString="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",
    project="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")
data_recorder = DataRecorder(setup_runs, DataLimit=750, RecordData=True)
recorded_runs = Panel(data_recorder)

pollinate = Pollinate(
    _runs=flatten(data_recorder),
    _name_="HACKATHON Runs",
    Description_="500 Runs",
    CPUNumber=14,
    IfEnabledRemoteRun=False,
    RunLocal=False,
    liveUpdateStatus=True)

check_job_status = CheckJobStatus(_job=pollinate, Index_=0, getBothInputOutputAssets=False, liveUpdateStatus=True)  # -> Status, Run

list_jobs = ListJobs(_project="adaptis/Tech", Status_="Completed", NumberOfJobs=10)  # -> Names, Descriptions, Recipes, Jobs
number_slider_10 = Slider(0, range=0..25)
panel_25 = Panel(list_jobs.Names)
panel_26 = Panel(list_jobs.Jobs)
item = ListItem(List=list_jobs.Jobs, Index=number_slider_10, Wrap=True)
item_2 = ListItem(List=list_jobs.Descriptions, Index=number_slider_10, Wrap=True)
item_3 = ListItem(List=list_jobs.Names, Index=number_slider_10, Wrap=True)
panel_27 = Panel(item_3)
panel_28 = Panel(item_2)
check_job_status_2 = CheckJobStatus(_job=item, Index_="3", getBothInputOutputAssets=False, liveUpdateStatus=False)
panel_29 = Panel("C:\Users\cameron lawrence\Documents\HACKATHON")
check_run_results = CheckRunResults(
    _run=check_job_status_2,
    recipeSource="https://api.pollination.cloud/registries/ladybug-tools/recipe/custom-energy-sim/0.3.12")  # -> Err, Html, Idf, Sql, Zsz
check_run_inputs = CheckRunInputs(
    _run=check_job_status_2,
    recipeSource="https://api.pollination.cloud/registries/ladybug-tools/recipe/custom-energy-sim/0.3.12")  # -> Ddy, Epw, Model, SimPar, User_input_1
load_assets = LoadAssets(Folder_=panel_29, Sql=check_run_results.Sql, liveUpdateStatus=False, postprocessWithHandler=True, useCachedAssets=True)  # -> Logs, Sql, Value_2
inputs = Panel(check_run_inputs.User_input_1)
load_assets_2 = LoadAssets(
    Folder_=panel_29,
    Model=check_run_inputs.Model,
    liveUpdateStatus=False,
    postprocessWithHandler=True,
    useCachedAssets=True)  # -> Logs, Model, Value_2

load_assets_3 = LoadAssets(Folder_=panel_29, Zsz=check_run_results.Zsz, liveUpdateStatus=False, postprocessWithHandler=True, useCachedAssets=True)  # -> Logs, Zsz, Value_2
readhvac = HBReadHVACSizing(sql=load_assets.Sql)  # -> zone_names, zone_peak_cool, zone_peak_heat, comp_types, comp_properties, comp_values; plug-in component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

customresult = HBReadCustomResult(sql=load_assets.Sql, output_names="Zone Mean Air Temperature")  # -> results; plug-in component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
customresult_2 = HBReadCustomResult(sql=load_assets.Sql, output_names="Zone Thermostat Heating Setpoint Temperature")  # -> results; plug-in component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
xdata = LBDeconstructData(data=customresult_2)  # -> header, simplify(values); plug-in component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
xdata_2 = LBDeconstructData(data=customresult)  # -> header, values; plug-in component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
subtraction = Subtraction(A=xdata_2.values, B=xdata.values)
larger = LargerThan(FirstNumber=subtraction, SecondNumber="1")  # -> LargerThan, OrEqualTo
num = Number(larger.LargerThan)
ma = MassAddition(Input=num)  # -> flatten(Result), PartialResults

# ----
# Hours
readzsz = HBReadZoneSizing(zsz=load_assets_3.Zsz)  # -> cooling_load, heating_load; plug-in component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

panel_30 = Panel(readhvac.zone_peak_cool)
panel_31 = Panel(readhvac.zone_names)

xdata_3 = LBDeconstructData(data=readzsz.cooling_load)  # -> header, values; plug-in component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
zones = Panel(xdata.header)
ma_2 = MassAddition(Input=xdata_3.values)  # -> flatten(Result), PartialResults
temperatures = Panel(xdata_2.values)
python_5 = GhPythonScript(x=ma_2.Result)  # -> out, a; inputs x: list
# ---------- python_5: Python ----------
__author__ = "cameron lawrence"
__version__ = "2022.09.17"

import rhinoscriptsyntax as rs

print(max(x))
# ---------- end python_5 ----------
panel_32 = Panel(python_5.out)
